# Dynamo graph RoomAdjacenciesByLevel.dyn (Dynamo 2.6.1.8786)
# packages: SteamNodes 1.2.4

categories = Categories("OST_Rooms")
all_elements_of_category = ElementsOfCategory(Category=categories)
name = FamilyType.Name(familyType=all_elements_of_category)
string = StringInput("C:\Users\maxime.lefrancois\Seafile\Bâtiment Intelligent FAYOL\ifc\230408_Mines_Maquette_numerique\schedules\adjacency_guid.csv")
code_block = CodeBlock { 0.8; }
getSurroundingElements = Custom[Tool.GetSurroundingElements](element=all_elements_of_category, ElementCheck=all_elements_of_category, Tolerance=code_block)  # package SteamNodes; Get Surrounding Elements by Categories, group them as List. Tolerance distance available.
python_script = Python(IN[0]=getSurroundingElements)
# ---------- python_script.python (33 lines) ----------
# Load the Python Standard and DesignScript Libraries
import sys
import clr
clr.AddReference('RevitAPI')
from Autodesk.Revit.DB import *
from Autodesk.Revit.DB import BuiltInParameter

# The inputs to this node will be stored as a list in the IN variables.
dataEnteringNode = IN

# Place your code below this line

input = IN[0] #type: List

OUT = []
for rooms in IN[0]:
  if len(rooms) != 1:
    continue
  adjacentRooms = rooms[0]
  out = set()
  for adjacentRoom in adjacentRooms[1:]:
    el = UnwrapElement(adjacentRoom)
    param = { p.Definition.Name: p.AsString() for p in el.Parameters if p.AsString() }
    #text = "/".join([param["Level"], param["Name"], param["Number"}, param["IfcGUID"])
    #text = "/".join([param["Level"], param["Number"]])
    text=param["IfcGUID"]
    out.add(text)
  el = UnwrapElement(adjacentRooms[0])
  param = { p.Definition.Name: p.AsString() for p in el.Parameters if p.AsString() }
  #text = "/".join([param["Level"], param["Number"]])
  text=param["IfcGUID"]
  out.remove(text)
  OUT.append([text] + list(out))
# ----------------------------------------
exportCSV = Data.ExportCSV(filePath=string, data=python_script)
